# Grasshopper definition Sets_Tree.ghx (Grasshopper 1.0.7)

# ---- group: Trim Tree
panel = Panel("""{0, 0, 0}
{50, 50, 0}""")
depth = Slider(1, range=-1..4)
panel_2 = Panel("""{0, 0, 0}
Null Point
{50, 50, 0}
<null>""")
flatten = FlattenTree(Tree=panel, Path="{0;1;0}")
flatten_2 = FlattenTree(Tree=panel_2, Path="{0;1;0}")
graft = GraftTree(Tree=flatten, IncludeEmptyLists=True, IncludeNullItems=True)
graft_2 = GraftTree(Tree=flatten_2, IncludeEmptyLists=True, IncludeNullItems=True)
merge = Merge(Data1=graft_2, Data2=graft)
gh_trim = CSharpScript(T=merge, D=depth)  # -> Tr; inputs T: tree, D: Int32
# ---------- gh_trim: C# ----------
    // Component written by @sonomirco

    // The component reduces the complexity of the tree,
    // merging the last index of the path and moving to the first stepping the number of times is defined by the value D.

    // Global parameter
    DataTree<object> trimedTree = new DataTree<object>();

    // First step we are checking that we are not taking more than one value for the input D.
    if(this.Component.Params.Input[1].VolatileDataCount > 1)
      this.Component.AddRuntimeMessage(GH_RuntimeMessageLevel.Warning, "This component only accepts a snigle number for Depth");

      // Second step is to check that input D is not less than zero.
    else if(D < 0)
      this.Component.AddRuntimeMessage(GH_RuntimeMessageLevel.Error, "Depth has to be a positive integer");

    else
    {
      int counter = 0;
      // We loop through the branches.
      for (int i = 0; i < T.BranchCount; i++)
      {
        // Collecting the path and data for each branch.
        GH_Path path = T.Path(i);
        List<object> branch = T.Branch(i);
        // If the path length is smaller than the input increment the counter of one;
        if(path.Length <= D)
          ++counter;
        else
        {
          // GH_Path class has a method to remove the last index of the path.
          // https://developer.rhino3d.com/api/grasshopper/html/M_Grasshopper_Kernel_Data_GH_Path_CullElement.htm
          // So we call the method inside a loop for the number of times is defined by the input D.
          for (int j = 0; j < D; j++)
          {
            path = path.CullElement();
          }
          // We add the values to the DataTree using the 'trimmed' path.
          trimedTree.AddRange(branch, path);
        }
      }
      // If the path length is smaller than input D trigger the counter.
      // If the counter is equal or bigger than one, we throw a warning message.
      if(counter >= 1)
      {
        string warningMessage = string.Format("The collapse depth is too large for {0} branches, they were omitted", counter);
        this.Component.AddRuntimeMessage(GH_RuntimeMessageLevel.Warning, warningMessage);
      }
    }
    // Output result.
    Tr = trimedTree;
# ---------- end gh_trim ----------
trim = TrimTree(Tree=merge, Depth=depth)
panel_3 = Panel(trim)
panel_4 = Panel(gh_trim)

# ----
mocked = CSharpScript()  # -> Tr
# ---------- mocked: C# ----------
    GH_Point[] mockedList = new GH_Point[4];
    mockedList[0] = new GH_Point(new Point3d(0, 0, 0));
    mockedList[1] = new GH_Point(Point3d.Unset);
    mockedList[2] = new GH_Point(new Point3d(50, 50, 0));
    mockedList[3] = null;

    DataTree<IGH_Goo> mockedTree = new DataTree<IGH_Goo>();

    for (int i = 0; i < mockedList.Length; i++)
    {
      GH_Path path = new GH_Path(i);
      mockedTree.Add(mockedList[i], path);
    }

    mockedTree.EnsurePath(mockedList.Length);

    Tr = mockedTree;
# ---------- end mocked ----------

# ---- group: Clean Tree
# GH#: A C# dictionary of Grasshopper3D components.
# 
# This file contains a category of Grasshopper components, and a mirroring C#/RhinoCommon implementation.
# 
# This is an educational project initiated by students/faculty of GSD-6338: Introduction to Computational Design, at the Harvard Graduate School of Design.
# 
# More information: {{project link}}
# Sets Text
remove_nulls = BooleanToggle(False)
remove_invalid = BooleanToggle(False)
remove_empty = BooleanToggle(False)
clean = CleanTree(RemoveNulls=remove_nulls, RemoveInvalid=remove_invalid, RemoveEmpty=remove_empty, Tree=mocked)
gh_clean = CSharpScript(N=remove_nulls, X=remove_invalid, E=remove_empty, T=mocked)  # -> Tr; inputs N: Boolean, X: Boolean, E: Boolean, T: tree
# ---------- gh_clean: C# ----------
    // Component written by @sonomirco

    // The component removes all the null and invalid values from the tree structure.

    // The first step is to check if the bool inputs are single values and not lists.
    // To check this, we take the information directly from the input parameters of the C# component.
    // Retrieving the VolatileDataCount we can have the count of values passed from each input.
    for (int i = 0; i <= 2; i++)
    {
      IGH_Param param = this.Component.Params.Input[i];
      if (param.VolatileDataCount > 1)
        this.Component.AddRuntimeMessage(GH_RuntimeMessageLevel.Error, string.Format("This component only accepts a single value for [{0}].", (string) param.NickName));
    }

    // If input N and X are true we enter in the if statement.
    if(N || X)
    {
      // Each branch in a DataTree is a list, and we have to declare the type of the list.
      // https://developer.rhino3d.com/api/grasshopper/html/M_Grasshopper_DataTree_1_Branch_1.htm
      // In our case the type of the list is an object because we want to keep the type as generic as possible starting from the DataTree.
      foreach (List<object> branch in T.Branches)
      {
        // If the branch is not null we enter in the statement.
        if(branch != null)
        {
          // Here a little trick to remove elements from a list without having problems with the order,
          // starting from the end of the list and moving backward.
          for (int j = branch.Count - 1; j >= 0; j += -1)
          {
            // We set a boolean value that we will use to trigger the action of removing the elements we want.
            bool flag = false;
            // This is another little trick for taking advantage of the IsValid property provided by the IGH_Goo
            // that is the interface for all the data inside Grasshopper.
            // https://developer.rhino3d.com/api/grasshopper/html/T_Grasshopper_Kernel_Types_IGH_Goo.htm
            // To obtain an IGH_Goo Grasshopper has a dedicated class to convert data into specific Goo, GH_Convert.
            // https://developer.rhino3d.com/api/grasshopper/html/T_Grasshopper_Kernel_GH_Convert.htm
            IGH_Goo tempValue = GH_Convert.ToGoo(branch[j]);
            // If the value is null and the input N is true we want to remove the null values, so we set the flag = true.
            // We use the property isValid to check the validity of the value
            // and if the input X is true, we set the flag = true.
            // Little note, because IsValid retrieves a true value we have to negate a false result to have true when the value is not valid.
            if(tempValue == null)
              flag = N;
            else if(X)
              flag = !tempValue.IsValid;
            // At the end if the flag is true, we remove the value at the index j.
            if(flag)
              branch.RemoveAt(j);
          }
        }
      }
    }
    // If E is true, so we want to remove empty branches.
    if(E)
    {
      // We use the same little trick as before so we start from the end and move backward.
      for (int i = T.Branches.Count - 1; i >= 0; i += -1)
      {
        // If the count of a branch (list of values) is less or equal to zero, meaning the list is empty.
        // Using RemovePath we remove the entire branch, from the DataTree.
        if(T.Branch(i).Count <= 0)
          T.RemovePath(i);
      }
    }

    // Output result.
    Tr = T;
# ---------- end gh_clean ----------
panel_5 = Panel(clean)
panel_6 = Panel(gh_clean)

# ---- group: Graf Tree
panel_7 = Panel(gh_clean)
include_null_items = BooleanToggle(True)
include_emplty_lists = BooleanToggle(True)
flatten_3 = FlattenTree(Tree=panel_7, Path="{0}")
gh_tree = CSharpScript(N=include_null_items, E=include_emplty_lists, T=panel_7)  # -> Tr; inputs N: Boolean, E: Boolean, T: tree
# ---------- gh_tree: C# ----------
    // Component written by @sonomirco

    // The component graft the data in a new data tree.

    // Global parameters
    DataTree<object> tree = new DataTree<object>();
    List<object> branch = null;

    // If the branch is not composed of a single branch, meaning a list, we enter in this statement.
    if(T.BranchCount > 1)
    {
      // We loop through each branch.
      for (int j = 0; j < T.BranchCount; j++)
      {
        // We extract each branch in a list.
        branch = T.Branch(j);
        // If the branch is null or doesn't have any data, we jump in this statement.
        if(branch == null || branch.Count == 0)
        {
          // If input E is true, so we want to consider null values, we enter in this statement.
          if(E)
          {
            // First thing we do is to create a path.
            // We take the path of the branch and we add an index path of value zero.
            // We add to our tree an empty list and the path defined.
            GH_Path path = T.Path(j).AppendElement(0);
            tree.AddRange(new List<object>(), path);
          }
        }
        else
        {
          // If the branch is not null, so we loop through all the data in the branch.
          for (int k = 0; k <= branch.Count - 1; k++)
          {
            // We create a new path for every single item, appending to the branch path the index of the loop.
            GH_Path path = T.Path(j).AppendElement(k);
            // If the value at index k in the branch is not null OR N is true so we want to consider null values.
            // We add to the tree the value with the new path.
            if(branch[k] != null || N)
              tree.Add(branch[k], path);
          }
        }
      }
    }
      // if the branch is a single list.
    else
    {
      // We take the branch.
      branch = T.Branch(0);
      // We loop for all the elements has inside.
      for (int j = 0; j < branch.Count; j++)
      {
        // If N input is false and the value at the index j is null we skip it and jump to the next interaction of the loop.
        if(!N && branch[j] == null)
          continue;
        // We create a new path for every single element of the list, appending the index j to the path.
        GH_Path path = T.Path(0).AppendElement(j);
        // We add each element in a separate branch defined by the path.
        tree.Add(branch[j], path);
      }
    }
    // Output result.
    Tr = tree;
# ---------- end gh_tree ----------
graft_3 = GraftTree(Tree=panel_7, IncludeEmptyLists=True, IncludeNullItems=True)
graft_4 = GraftTree(Tree=flatten_3, IncludeEmptyLists=False, IncludeNullItems=True)
panel_8 = Panel(graft_4)
panel_9 = Panel(gh_tree)
panel_10 = Panel(graft_3)

# ----
mocked_2 = CSharpScript(T=graft_3)  # -> Tr; inputs T: tree
# ---------- mocked_2: C# ----------
    DataTree<object> mockedTree = new DataTree<object>();
    for (int i = 0; i < T.BranchCount; i++)
    {
      GH_Path path = T.Path(i);
      path = path.PrependElement(0);
      mockedTree.AddRange(T.Branch(i), path);
    }

    Tr = mockedTree;
# ---------- end mocked_2 ----------

# ---- group: Simplify Tree
front = BooleanToggle(True)
panel_11 = Panel(mocked_2)
simplify = SimplifyTree(Tree=panel_11, Front=front)
gh_simplify = CSharpScript(T=panel_11, F=front)  # -> Tr; inputs T: tree, F: Boolean
# ---------- gh_simplify: C# ----------
    // Component written by @sonomirco

    // The component remove the overlap indexes for each branch's path.
    // For this component we can obtain the same result using two different ways, using the DataTree object or GH_Structure object.
    // Here two links that explain the difference between the two objects.
    // https://discourse.mcneel.com/t/datatree-vs-igh-structure/67242
    // https://discourse.mcneel.com/t/datatree-t-or-gh-structure-t-in-visual-studio/106871

    // The DataTree class has a method SimplifyPaths that carry out perfectly the main goal, but it doesn't give you
    // the full capability provided from the component provided with the input boolean F.
    // Here the method using DataTree
    // T.SimplifyPaths();

    // To represent the full behavior of the component we decided to use GH_Structure.
    // We collect the data from the component input because VolatileData is structured as GH_Structure.
    // And we make a copy of the collected data, so we avoid overwriting the original values.
    // Because we are declaring a specific type, we have to cast the VolatileData in GH_Structure<IGH_Goo>.
    GH_Structure<IGH_Goo> struFromInput = (GH_Structure<IGH_Goo>) this.Component.Params.Input[0].VolatileData;
    GH_Structure<IGH_Goo> copiedStru = struFromInput.ShallowDuplicate();
    // These two lines of code can be shrunk into one line like this
    // GH_Structure<IGH_Goo> copiedStru = ((GH_Structure<IGH_Goo>) this.Component.Params.Input[0].VolatileData).ShallowDuplicate();

    // The Simplify method we will use, required a GH_SimplificationMode, here we initialize it.
    // https://developer.rhino3d.com/api/grasshopper/html/T_Grasshopper_Kernel_Data_GH_SimplificationMode.htm
    GH_SimplificationMode simplificationMode = GH_SimplificationMode.CollapseAllOverlaps;
    // If input F is true, we change the type of simplification mode.
    if(F)
      simplificationMode = GH_SimplificationMode.CollapseLeadingOverlaps;
    // We use the simplify method.
    // https://developer.rhino3d.com/api/grasshopper/html/M_Grasshopper_Kernel_Data_IGH_Structure_Simplify.htm
    copiedStru.Simplify(simplificationMode);
    // Here the problem of using GH_Structure we can't output, because grasshopper is not able to converted in DataTree straingh away.
    // So to solve this problem, we created a small function.
    // Output result.
    Tr = StructureToDataTree(copiedStru);
# ---------- gh_simplify: C# additional code ----------
  private DataTree<IGH_Goo> StructureToDataTree(GH_Structure<IGH_Goo> structure)
  {
    // We instantiate a tree.
    DataTree<IGH_Goo> tree = new DataTree<IGH_Goo>();
    // We loop through each branch and copied in the DataTree.
    for(int i = 0;i < structure.Branches.Count;++i)
    {
      tree.AddRange((List<IGH_Goo>) structure.get_Branch(i), structure.get_Path(i));
    }
    // We return the tree.
    return tree;
  }
# ---------- end gh_simplify ----------
panel_12 = Panel(simplify)
panel_13 = Panel(gh_simplify)

# ---- group: Prune Tree
series = Series(Start=0, Step=1, Count=3)
series_2 = Series(Start=0, Step=1, Count=6)
series_3 = Series(Start=0, Step=1, Count=4)
number_slider = Slider(3, range=-1..10)
n1 = Slider(6, range=1..10)
entwine = Entwine(Branch00=series, Branch01=series_2, Branch02=series_3, FlattenInputs=True)
gh_prune = CSharpScript(T=entwine, N_0=number_slider, N_1=n1)  # -> out, Tr; inputs T: tree, N_0: Int32, N_1: Int32
# ---------- gh_prune: C# ----------
    // Component written by @sonomirco

    // This component removes all branches from a Tree that are smaller or bigger than the input thresholds provided.
    // For this component we will use the method RemovePath.
    // https://developer.rhino3d.com/api/grasshopper/html/M_Grasshopper_DataTree_1_RemovePath.htm

    // Looping through the DataTree.
    for (int i = 0; i < T.BranchCount; i++)
    {
      // Record the path of the branch.
      GH_Path path = T.Path(i);
      // If the dimension of the branch is smaller than input N_0, remove the path.
      if(T.Branch(i).Count < N_0)
        T.RemovePath(path);
        // If the dimension of the branch is bigger than input N_1, remove the path.
      else if(T.Branch(i).Count > N_1)
        T.RemovePath(path);
    }
    // Output result.
    Tr = T;
# ---------- end gh_prune ----------
prune = PruneTree(Tree=entwine, Minimum=number_slider, Maximum=n1)
panel_14 = Panel(prune)
panel_15 = Panel(gh_prune.Tr)

# ---- group: Flatten Tree
panel_16 = Panel(merge)
path = DataPath("{0;1;0;1}")
flatten_4 = FlattenTree(Tree=panel_16, Path="{0;1;0;1}")
gh_flatten = CSharpScript(T=panel_16, P=path)  # -> out, Tr; inputs T: tree
# ---------- gh_flatten: C# ----------
    // Component written by @sonomirco

    // The component flatten all the branches into one.

    // DataTree and GH_Structure have the same method Flatten, so for simplicity, we will use DataTree object.

    // First things first, because C# component doesn't have an input type GH_Path we have to cast the input
    // P that we pass as a generical object in a GH_Path.
    // We can do this in two ways:
    // GH_Path path = P as GH_Path;
    GH_Path path = (GH_Path) P;
    // https://developer.rhino3d.com/api/grasshopper/html/M_Grasshopper_DataTree_1_Flatten.htm
    T.Flatten(path);

    // Output result.
    Tr = T;
# ---------- end gh_flatten ----------
panel_17 = Panel(flatten_4)
panel_18 = Panel(gh_flatten.Tr)

# ---- group: Unflatten Tree
panel_19 = Panel(gh_flatten.Tr)
tree = Data(merge)
gh_unflatten = CSharpScript(T=panel_19, G=tree)  # -> Tr; inputs T: tree, G: tree
# ---------- gh_unflatten: C# ----------
    // Component written by @sonomirco

    // The component moves items back into branches.

    // Glabal variables.
    DataTree<object> tree = new DataTree<object>();
    int startingRange = 0;
    // We flat the input tree T, and we extract the first branch in a list.
    T.Flatten();
    List<object> flattenTree = T.Branch(0);

    // We looping through the branches of tree input G.
    for (int i = 0; i < G.BranchCount; i++)
    {
      // Collecting branch path and count in two variables.
      GH_Path path = G.Path(i);
      int branchCount = G.Branch(i).Count;
      // If the length of the list, minus the startingRange incremented  every interaction, is less than the length of the branch
      // we throw an error message and the result produced until this point.
      if (flattenTree.Count - startingRange < branchCount)
      {
        this.Component.AddRuntimeMessage(GH_RuntimeMessageLevel.Error, "Flattened tree has fewer items than guide tree.");
        Tr = tree;
        return;
      }
      // We extract a subList using the method GetRange.
      // https://docs.microsoft.com/en-us/dotnet/api/system.collections.generic.list-1.getrange?view=net-5.0
      List<object> subSet = flattenTree.GetRange(startingRange, branchCount);
      // We add the subList to the new tree with the path provided by input G.
      tree.AddRange(subSet, path);
      // We increase the startingRange of the branch's length, so next time we will use GetRange, it will start
      // after the value-added in the previous interaction.
      // Using this way we don't remove items from the list, so we keep the input unmutated.
      startingRange += branchCount;
    }
    // If the length of the list minus the startingRange incremented every interaction is bigger than zero
    // we throw an error message.
    if(flattenTree.Count - startingRange > 0)
      this.Component.AddRuntimeMessage(GH_RuntimeMessageLevel.Error, "Flattened tree has more items than guide tree.");

    // Output result.
    Tr = tree;
# ---------- end gh_unflatten ----------
unflatten = UnflattenTree(Tree=panel_19, Guide=tree)
panel_20 = Panel(unflatten)
panel_21 = Panel(gh_unflatten)

# ---- group: Tree Statistics
panel_22 = Panel(entwine)
tstat = TreeStatistics(Tree=panel_22)  # -> Paths, Length, Count
gh_tstat = CSharpScript(T=panel_22)  # -> P, L, C; inputs T: tree
# ---------- gh_tstat: C# ----------
    // Component written by @sonomirco

    // The component provide some information regarding the tree, paths, branch lengths, number of branches.

    // Global parameters.
    GH_Path[] paths = new GH_Path[T.BranchCount];
    int[] branchLength = new int[T.BranchCount];
    // Looping through the branches.
    for (int i = 0; i < T.BranchCount; i++)
    {
      // Collecting branch path and count in the two arrays.
      paths[i] = T.Path(i);
      branchLength[i] = T.Branch(i).Count;
    }
    // Output resut.
    P = paths;
    L = branchLength;
    C = T.BranchCount;
# ---------- end gh_tstat ----------
panel_23 = Panel(tstat.Paths)
panel_24 = Panel(gh_tstat.P)
panel_25 = Panel(tstat.Length)
panel_26 = Panel(gh_tstat.L)
panel_27 = Panel(gh_tstat.C)
panel_28 = Panel(tstat.Count)
