# Grasshopper definition Vector_Grid.ghx (Grasshopper 1.0.7)

c_script = CSharpScript()  # -> Out, C, P
trigrid = Triangular(Plane=PlaneXY(0, 0, 0), Size=1, ExtentX=5, ExtentY=5)  # -> Cells, Points

c_radgrid = CSharpScript()  # -> Out, C, P

# ---- group: GH RadGrid
radgrid = Radial(Plane=PlaneXY(0, 0, 0), Size=1, ExtentR=5, ExtentP=20)  # -> Cells, Points

# ----
c_popgeo = CSharpScript()  # -> Out, P

# ---- group: GH PopGeo
popgeo = PopulateGeometry(Count=100, Seed=1)

# ----
number_slider = Slider(3, range=0..100)
number_slider_2 = Slider(20, range=0..100)
number_slider_3 = Slider(20, range=0..100)
pln = Plane(PlaneXY(6.002839061, 8.575233017, 0))
c_sqgrid = CSharpScript(Pln=pln, S=number_slider, Ex=number_slider_2, Ey=number_slider_3)  # -> out, C, P; inputs Pln: Plane, S: Double, Ex: Int32, Ey: Int32
# ---------- c_sqgrid: C# ----------
    // Component written by @krichterlunn

    // Creating variables for you x and y plan origin
    // This you to move your plane and maintain the same relationship
    double iPX = Pln.OriginX;
    double iPY = Pln.OriginY;

    // Declare your new lists which you will be creating (point, line, plane, rectangle)
    List<Point3d> pts = new List<Point3d>();
    List<Line> grid = new List<Line>();
    List<Plane> Pln2 = new List<Plane>();
    List<Rectangle3d> rectangle = new List<Rectangle3d>();

    // Creating your points using two for loops
    // First loop runs through all your rows for y and multiplies it by your value Sy (input value)
    // Second loop runs through all your columns for x and multiplies it by your value Sx (input value)
    // These points are then oriented to the plane iPx and iPy which we declared at the begining.
    for(int j = 0; j < Ey; j++){
      double y = j * S;
      for(int i = 0; i < Ex; i++){
        double x = i * S;
        pts.Add(new Point3d(x + iPX, y + iPY, 0.0)); // new points(x, y, z)
      }
    }

    // This loop runs through all the points we created above and creates a new plane at each point
    // From those planes we are then able to create our rectangles with take (plane, x, y) as its input
    for(int k = 0; k < pts.Count; k++){
      Plane tempP = new Plane(Pln);
      tempP.Origin = pts[k];
      Rectangle3d Rec = new Rectangle3d(tempP, S, S);
      rectangle.Add(Rec); // new rectangle
    }
    
    // Output
    P = pts;
    C = rectangle;
# ---------- end c_sqgrid ----------
panel = Panel(c_sqgrid.C)
panel_2 = Panel(c_sqgrid.P)

# ---- group: GH SqGrid
sqgrid = Square(Plane=pln, Size=number_slider, ExtentX=number_slider_2, ExtentY=number_slider_3)  # -> Cells, Points

# ----
panel_3 = Panel(sqgrid.Cells)
panel_4 = Panel(sqgrid.Points)

number_slider_4 = Slider(6, range=0..100)
number_slider_5 = Slider(7, range=0..100)
number_slider_6 = Slider(20, range=0..100)
number_slider_7 = Slider(17, range=0..100)
pln_2 = Plane(PlaneXY(6.002839061, 8.575233017, 0))
c_recgrid = CSharpScript(Pln=pln_2, Sx=number_slider_4, Sy=number_slider_5, Ex=number_slider_6, Ey=number_slider_7)  # -> out, C, P; inputs Pln: Plane, Sx: Double, Sy: Double, Ex: Int32, Ey: Int32
# ---------- c_recgrid: C# ----------
    // Component written by @krichterlunn

    // Creating variables for you x and y plan origin
    // This you to move your plane and maintain the same relationship
    double iPX = Pln.OriginX;
    double iPY = Pln.OriginY;

    // Declare your new lists which you will be creating (point, line, plane, rectangle)
    List<Point3d> pts = new List<Point3d>();
    List<Line> grid = new List<Line>();
    List<Plane> Pln2 = new List<Plane>();
    List<Rectangle3d> rectangle = new List<Rectangle3d>();

    // Creating your points using two for loops
    // First loop runs through all your rows for y and multiplies it by your value Sy (input value)
    // Second loop runs through all your columns for x and multiplies it by your value Sx (input value)
    // These points are then oriented to the plane iPx and iPy which we declared at the begining
    for(int j = 0; j < Ey; j++){
      double y = j * Sy;
      for(int i = 0; i < Ex; i++){
        double x = i * Sx;
        pts.Add(new Point3d(x + iPX, y + iPY, 0.0)); // new points(x,y,z)
      }
    }

    // This loop runs through all the points we created above and creates a new plane at each point
    // From those planes we are then able to create our rectangles with take (plane, x, y) as its input
    for(int k = 0; k < pts.Count; k++){
      Plane tempP = new Plane(Pln);
      tempP.Origin = pts[k];
      Rectangle3d Rec = new Rectangle3d(tempP, Sx, Sy);
      rectangle.Add(Rec); //new rectangles
    }

    // Output
    P = pts;
    C = rectangle;
# ---------- end c_recgrid ----------
panel_5 = Panel(c_recgrid.C)
panel_6 = Panel(c_recgrid.P)

# ---- group: GH RecGrid
recgrid = Rectangular(Plane=pln_2, SizeX=number_slider_4, SizeY=number_slider_5, ExtentX=number_slider_6, ExtentY=number_slider_7)  # -> Cells, Points

# ----
panel_7 = Panel(recgrid.Cells)
panel_8 = Panel(recgrid.Points)

# ----
# GH#: A C# dictionary of Grasshopper3D components.
# 
# This file contains a category of Grasshopper components, and a mirroring C#/RhinoCommon implementation.
# 
# This is an educational project initiated by students/faculty of GSD-6338: Introduction to Computational Design, at the Harvard Graduate School of Design.
# 
# More information: {{project link}}
# Vector Grid
# Vector Grid Incomplete: Radial (RadGrid)
# Triangular (TriGrid)
# Populate Geometry (PopGeo)
number_slider_8 = Slider(6, range=0..100)
number_slider_9 = Slider(11, range=0..100)
number_slider_10 = Slider(10, range=0..100)
pln_3 = Plane(PlaneXY(6.002839061, 8.575233017, 0))
c_hexgrid = CSharpScript(Pln=pln_3, S=number_slider_8, Ex=number_slider_10, Ey=number_slider_9)  # -> out, C, P; inputs Pln: Plane, S: Double, Ex: Int32, Ey: Int32
# ---------- c_hexgrid: C# ----------
    // Component written by @krichterlunn

    // Creating variables for you x and y plan origin
    // This you to move your plane and maintain the same relationship
    double iPX = Pln.OriginX;
    double iPY = Pln.OriginY;

    // Declare your new lists which you will be creating (point, line, plane, cirlce, polyline)
    List<Point3d> pts = new List<Point3d>();
    List<Line> grid = new List<Line>();
    List<Plane> Pln2 = new List<Plane>();
    List<Circle> circles = new List<Circle>();
    List<Polyline> hexagons = new List<Polyline>();

    // Here you create your center points from which you can create your cirlces and hexagons
    // running through two loops: one for your rows and one for your columns you can then determine the
    // spacing and position of each point based on equations related to the hexagon
    for(int j = 0; j < Ey; j++){
      double y = 3 * S * Math.Tan(Math.PI / 6.0) * j + iPY;
      for(int i = 0; i < Ex; i++){
        double x = 1.5 * S * i + iPX;

        Point3d pt = new Point3d(x, y, 0.0);

        if(i % 2 == 1){
          pt.Y += 1.5 * S * Math.Tan(Math.PI / 6.0);
        }
        pts.Add(pt);
      }
    }

    // For each point you will now oriente a new plane at that point
    // This will allow you to construct a circle and then a polygon at those points
    for(int k = 0; k < pts.Count; k++){
      Plane tempP = new Plane(Pln);
      tempP.Origin = pts[k];
      Circle circ = new Circle(tempP, S);
      circles.Add(circ);
      Polyline hex = Polyline.CreateInscribedPolygon(circ, 6);
      hexagons.Add(hex);
    }

    // Output
    P = pts;
    C = hexagons;
# ---------- end c_hexgrid ----------
panel_9 = Panel(c_hexgrid.C)
panel_10 = Panel(c_hexgrid.P)

# ---- group: GH HexGrid
hexgrid = Hexagonal(Plane=pln_3, Size=number_slider_8, ExtentX=number_slider_10, ExtentY=number_slider_9)  # -> Cells, Points

# ----
panel_11 = Panel(hexgrid.Cells)
panel_12 = Panel(hexgrid.Points)

number_slider_11 = Slider(51, range=0..1000)
number_slider_12 = Slider(3, range=0..10)
rec = Rectangle({Plane=PlaneXY(16.52941808, 22.96342887, 0), Size=Domain2(u=-12.16496808..12.16496808, v=-19.19207777..19.19207777)})
c_pop2d = CSharpScript(R=rec, N=number_slider_11, S=number_slider_12)  # -> out, P; inputs R: Box, N: Double, S: Int32
# ---------- c_pop2d: C# ----------
    // Component written by @krichterlunn and @mirahx24

    // Create List of points to hold randon points
    List<Point3d> pts = new List<Point3d>();

    // Random is a native C# class
    // We can initialize it with a seed
    // Create random float numbers by creating two number -- one is the integer and one is the remainder -- and combine them into one
    Random random = new Random(S);
    for(int i = 0; i < N; i++){
      double x = random.Next(Convert.ToInt32(R.X.Min), Convert.ToInt32(R.X.Max)); // integer part
      double xRemain = random.NextDouble(); // remainder part
      x += xRemain;
      double y = random.Next(Convert.ToInt32(R.Y.Min), Convert.ToInt32(R.Y.Max)); // integer part
      double yRemain = random.NextDouble(); // remainder part
      y += yRemain;

      // Create new points using the x and y values and add it to the list of points
      pts.Add(new Point3d(x, y, 0.0));
    }

    // Output
    P = pts;
# ---------- end c_pop2d ----------
panel_13 = Panel(c_pop2d.P)

# ---- group: GH Pop2D
pop2d = Populate2D(Region=rec, Count=number_slider_11, Seed=number_slider_12)

# ----
panel_14 = Panel(pop2d)

number_slider_13 = Slider(51, range=0..1000)
number_slider_14 = Slider(3, range=0..10)
brep = Brep(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)
c_pop3d = CSharpScript(R=brep, N=number_slider_13, S=number_slider_14)  # -> out, P; inputs R: Box, N: Double, S: Int32
# ---------- c_pop3d: C# ----------
    // Component written by @krichterlunn and @mirahx24
    
    // Create List of points to hold randon points
    List<Point3d> pts = new List<Point3d>();

    // Random is a native C# class
    // We can initialize it with a seed
    // Create random float numbers by creating two number -- one is the integer and one is the remainder -- and combine them into one
    var random = new Random(S);

    for(int i = 0; i < N; i++){
      double x = random.Next(Convert.ToInt32(R.X.Min), Convert.ToInt32(R.X.Max)); // x integer
      double xRemain = random.NextDouble(); // x remainder
      x += xRemain;
      double y = random.Next(Convert.ToInt32(R.Y.Min), Convert.ToInt32(R.Y.Max)); // y integer
      double yRemain = random.NextDouble(); // y remainder
      y += yRemain;
      double z = random.Next(Convert.ToInt32(R.Z.Min), Convert.ToInt32(R.Z.Max)); // z integer
      double zRemain = random.NextDouble(); // z remainder
      z += zRemain;
      
      // Create new points using the x, y, and z values and add it to the list of points
      pts.Add(new Point3d(x, y, z));
    }

    // Output
    P = pts;
# ---------- end c_pop3d ----------
panel_15 = Panel(c_pop3d.P)

# ---- group: GH Pop3D
pop3d = Populate3D(Region=brep, Count=number_slider_13, Seed=number_slider_14)

# ----
panel_16 = Panel(pop3d)
