# Grasshopper definition Curve_Analysis.ghx (Grasshopper 1.0.7)

geo = Geometry(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)
c_crvgraph = CSharpScript(C=geo, S=Slider(180, range=0..1000))  # -> out, P, Crv; inputs C: Curve, S: Double
# ---------- c_crvgraph: C# ----------
    // Component written by @joonhaeng-code
    // This grasshopper component express curvature graph in form of curve

    
    // Let's make a list of points which will be a point to make a curvature curve.
    List<Point3d> pt = new List<Point3d>();

    // k will be the number of points which will represent curvature graph. you can modifiy it.
    // if k is too small, curvature graph would be too simplyfied.
    int k = 100;

    // using for loop, let's get curvature vectors
    for ( int i = 0, n = k + 1; i < n; i++){

      Point3d dividPt = C.PointAt(C.DivideByCount(k, true)[i]);
      Vector3d temp = C.CurvatureAt(C.DivideByCount(k, true)[i]);

      // move k points on curve in direction of curvature.
      double tempr = temp.Length;
      pt.Add(dividPt + temp * S * -1);

    }

    P = pt;
    Crv = Curve.CreateInterpolatedCurve(pt, 3);
# ---------- end c_crvgraph ----------
panel = Panel(c_crvgraph.P)
panel_2 = Panel(c_crvgraph.Crv)

# ---- group: Grasshopper CrvGraph
crvgraph = CurvatureGraph(Curve=geo, Density=5, Scale=Slider(115, range=0..1000))

# ----
pt = Point(Point(-2.47056265, 4.097518542, 0))
crv = Curve(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)

# ---- group: C# Cur CP
c_cp = CSharpScript(P=pt, C=crv)  # -> out, Pt, t, D; inputs P: Point3d, C: Curve
# ---------- c_cp: C# ----------
    // Component written by @joonhaeng-code
    // joonhaenglee@gsd.harvard.edu

    // Now we will get a closest point on input curve from input point.
    // To do that I found one function that find curve parameter t of the closest point.
    // Curve.Closest Point( input Point, Out t)
    // To extract the value t, we need to define that value first. lets say that as tempt (temporary t value).

    double tempt;

    // And run the function to get tempt

    C.ClosestPoint(P, out tempt);

    // Good! Now we have tempt value. It means, we can get the actual Point3d with xyz value in it.
    // Curve.PointAt(t) returns a point on input t value. Let's use this.

    Point3d pointOnCurve = C.PointAt(tempt);

    // Now you have a tempt and a point!
    // Lastly, lets get the distance between the input point and closest point!

    double distance = P.DistanceTo(pointOnCurve);

    // Done!
    // Now lets send tempt, pointOnCurve, and distance to c# output value.

    Pt = pointOnCurve;
    t = tempt;
    D = distance;
# ---------- end c_cp ----------

# ---- group: Grasshopper Cur CP
crv_cp = CurveClosestPoint(Point=pt, Curve=crv)  # -> Point, Parameter, Distance

# ----
panel_3 = Panel(crv_cp.Point)
panel_4 = Panel(crv_cp.Parameter)
panel_5 = Panel(crv_cp.Distance)
panel_6 = Panel(c_cp.Pt)
panel_7 = Panel(c_cp.t)
panel_8 = Panel(c_cp.D)

geo_2 = Geometry(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)
geo_3 = Geometry(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)
c_crvprox = CSharpScript(A=geo_2, B=geo_3)  # -> out, PtA, PtB, D; inputs A: Curve, B: Curve
# ---------- c_crvprox: C# ----------
    // Component written by @joonhaeng-code
    // joonhaenglee@gsd.harvard.edu

    // We will get a points in each curve which makes minial distance between two curves.
    // There is a method in Curve class to do this fucntion.
    // Curve.ClosestPoints( Curve, out Point1, out Point2)
    // to use this function, we need to define Point1 and Point2 first.

    // Let's make empty two Point3ds.

    Point3d Pt1;
    Point3d Pt2;

    // Let's use the method to get two points!

    A.ClosestPoints(B, out Pt1, out Pt2);

    // Now we have two Points. Pt1 is a point on A curve, and Pt2 is a curve on B.

    // Lastly, lets send this data to our C# component output.

    PtA = Pt1;
    PtB = Pt2;

    // One more, Let's get distance between those two points!

    D = Pt1.DistanceTo(Pt2);
# ---------- end c_crvprox ----------
panel_9 = Panel(c_crvprox.PtA)
panel_10 = Panel(c_crvprox.PtB)
panel_11 = Panel(c_crvprox.D)

# ---- group: Grasshopper CrvProx
crvprox = CurveProximity(CurveA=geo_2, CurveB=geo_3)  # -> PointA, PointB, Distance

# ----
panel_12 = Panel(crvprox.PointA)
panel_13 = Panel(crvprox.PointB)
panel_14 = Panel(crvprox.Distance)

crv_2 = Curve(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)
c_midpt = CSharpScript(C=crv_2)  # -> out, M; inputs C: Curve
# ---------- c_midpt: C# ----------
    // Component written by @joonhaeng-code
    // joonhaenglee@gsd.harvard.edu

    // Now we will get a middle point of input curve.
    // What is middle by the way? It could be the point that divide curve into two curves with same length.
    //
    // From Rhinocommon documentation, there is a function(below) that get Point that get a point at certain length from the startpoint.
    // Curve.PointAtLengt(Length)
    
    // So, If I know the "half length" of the curve, we might get the point in the middle.
    // To get "half length" lets try to get full length of the curve by using syntax
    // Curve.GetLength();
    
    double leng = C.GetLength();
    
    // Since we have leng, which is length of the curve, we can use 
    // Curve.PointAtLengt(half length)
    
    M = C.PointAtLength(leng / 2);
# ---------- end c_midpt ----------
panel_15 = Panel(c_midpt.M)

# ---- group: Grasshopper MidPt
midpt = CurveMiddle(Curve=crv_2)

# ----
panel_16 = Panel(midpt)

rec = Geometry(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)
c_drec = CSharpScript(R=rec)  # -> out, B, X, Y; inputs R: Rectangle3d
# ---------- c_drec: C# ----------
    // Component written by @joonhaeng-code
    // joonhaenglee@gsd.harvard.edu

    // We will going to get Base Plane, width(X) and height(Y) of Rectangle.
    // Luckly, those are all properties of Rectangle.
    // So we can get those values directly buy using below.

    B = R.Plane;
    X = R.X;
    Y = R.Y;
# ---------- end c_drec ----------
panel_17 = Panel(c_drec.B)
panel_18 = Panel(c_drec.X)
panel_19 = Panel(c_drec.Y)

# ---- group: Grasshopper DRec
drec = DeconstuctRectangle(Rectangle=rec)  # -> BasePlane, XInterval, YInterval

# ----
panel_20 = Panel(drec.YInterval)
panel_21 = Panel(drec.BasePlane)
panel_22 = Panel(drec.XInterval)

crv_3 = Curve(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)
c_cls = CSharpScript(C=crv_3)  # -> out, Cl, P; inputs C: Curve
# ---------- c_cls: C# ----------
    // Component written by @joonhaeng-code
    // joonhaenglee@gsd.harvard.edu

    // We will check whether the input curve is closed and is periodic.
    // Those are the properties of the curve.
    // We can get those value by using function below.

    Cl = C.IsClosed;
    P = C.IsPeriodic;
# ---------- end c_cls ----------
panel_23 = Panel(c_cls.Cl)
panel_24 = Panel(c_cls.P)

# ---- group: Grasshopper Cls
cls = Closed(Curve=crv_3)  # -> Closed, Periodic

# ----
panel_25 = Panel(cls.Closed)
panel_26 = Panel(cls.Periodic)

# ----
# Curve Analysis
crv_4 = Curve(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)

# ---- group: Grasshopper CP
# GH#: A C# dictionary of Grasshopper3D components.
# 
# This file contains a category of Grasshopper components, and a mirroring C#/RhinoCommon implementation.
# 
# This is an educational project initiated by students/faculty of GSD-6338: Introduction to Computational Design, at the Harvard Graduate School of Design.
# 
# More information: {{project link}}
cp = ControlPoints(Curve=crv_4)  # -> Points, Weights, Knots

# ---- group: c# CP
c_cp_2 = CSharpScript(C=crv_4)  # -> out, P, W, K; inputs C: Curve
# ---------- c_cp_2: C# ----------
    // Component written by @joonhaeng-code
    // joonhaenglee@gsd.harvard.edu

    // We will going to get Control Points, Weight, and Knots from curve.
    // Oh, in Rhinocommon, we can get those values from NurbsCurve Class since those are the properties of NurbsCurve.
    // Let change our Curve input to NurbsCurve.

    NurbsCurve tempC = C.ToNurbsCurve();

    // There will be more than one items or values in Point, Weight, and Knot. So I will going to make empty lists.

    List <Point3d> controlPoint = new List<Point3d>();
    List <double> Weights = new List<double>();
    List <double> Knots = new List<double>();

    // Lets get Control Points and Weights.
    // Control Point is a property of Nurbscurve, and Weight is a property of Control Point. So, we can use
    // Nurbscurve.Points
    // Nurbscurve.Points.GetWeight
    //
    // Let's get those value using for loop.
    // I will define a n value as the number of control points in Nurbscurve.

    int n = tempC.Points.Count;

    for (int i = 0 ; i < n ; i++)
    {

      // It does not mean that Control Point is same as point.
      // To get XYZ coordinate of control point, we have do extract XYZ value from control points and make a new points.

      Point3d tempControlPoint = new Point3d(tempC.Points[i].X, tempC.Points[i].Y, tempC.Points[i].Z);

      // Now tempControlPoint is a temporary new point on the [i]th controlpoint on Nurbscurve. Let's Put this point in our list.

      controlPoint.Add(tempControlPoint);

      // To get weight of control point, we can use
      // NurbsCurve.Points.GetWeight();

      double tempW = tempC.Points.GetWeight(i);

      // Let's add this weight value in our list.
      Weights.Add(tempW);

    }

    // Let's get Knots value using for loop.
    // I will define a np value as the number of knots in Nurbscurve.

    int np = tempC.Knots.Count;

    for (int i = 0 ; i < np ; i++)
    {
      Knots.Add(tempC.Knots[i]);
    }

    // Done!
    // Lastly, lets sent this list to our output values of this C# component.


    P = controlPoint;
    W = Weights;
    K = Knots;
# ---------- end c_cp_2 ----------

# ----
panel_27 = Panel(cp.Points)
panel_28 = Panel(cp.Weights)
panel_29 = Panel(cp.Knots)
panel_30 = Panel(c_cp_2.P)
panel_31 = Panel(c_cp_2.W)
panel_32 = Panel(c_cp_2.K)

# ---- group: WORKING
polygon = Geometry(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)
c_pcen = CSharpScript(P=polygon)  # -> out, Cv, Ce, Ca; inputs P: Polyline
# ---------- c_pcen: C# ----------
    // Component written by @joonhaeng-code
    // This grasshopper component gets 3 types of center points from Polyline
    
    
    // First, Let's define temporary 0 values to contain sum of each vertex valuses. 
    double tempX = 0;
    double tempY = 0;
    double tempZ = 0;
    int n = P.Count;
    
    // For loop to add vertex valuses
    for (int i = 0 ; i < n  ; i++)
    {
      tempX = tempX + P.X[i];
      tempY = tempY + P.Y[i];
      tempZ = tempZ + P.Z[i];
    }

    // get average value and create a point.
    Point3d centerVertex = new Point3d(tempX / n, tempY / n, tempZ / n);

    // To get center area center point, lets make suface first and get mass centroid
    Brep[] brep = Brep.CreatePlanarBreps(P.ToNurbsCurve(), 0.001);
    if (brep != null && brep.Length > 0) {
      AreaMassProperties props = AreaMassProperties.Compute(brep[0]);
      Ca = props.Centroid;
    }

    Cv = centerVertex;
    
    // Center of edge point
    Ce = P.CenterPoint();
# ---------- end c_pcen ----------
panel_33 = Panel(c_pcen.Cv)
panel_34 = Panel(c_pcen.Ce)
panel_35 = Panel(c_pcen.Ca)

# ---- group: WORKING / Grasshopper PCen
pcen = PolygonCenter(Polyline=polygon)  # -> CenterV, CenterE, CenterA

# ---- group: WORKING (continued)
panel_36 = Panel(pcen.CenterV)
panel_37 = Panel(pcen.CenterE)
panel_38 = Panel(pcen.CenterA)

# ----
geo_4 = Geometry(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)
c_disc = CSharpScript(C=geo_4, L="3")  # -> out, P, t; inputs C: Curve, L: Int32
# ---------- c_disc: C# ----------
    // Component written by @joonhaeng-code
    // This grasshopper component checks contiuity of the curve.

    // There are 3 types of input L, 1,2,and 3. Those are choosing which curve continuous options to search.
    // In Rhinocommon, it is possible to search 'Next non-Continuity parameter' on curve rather than the number of total non continuity points.
    // So let's make empty list to put non continuity points, and count the number of each list.

    double temp;
    List<double> discont = new List<double>();
    List<Point3d> pts = new List<Point3d>();

    double a = C.Domain[0];
    double b = C.Domain[1];

    discont.Add(C.Domain[0]);
    pts.Add(C.PointAt(C.Domain[0]));

    // Check C1 continuity
    if( L == 1){
      while( C.GetNextDiscontinuity(Rhino.Geometry.Continuity.C1_continuous, a, b, out temp) ) {
        discont.Add(temp);
        pts.Add(C.PointAt(temp));
        a = temp;
      }
    }
      // Check C2 continuity
    else if(L == 2){
      while( C.GetNextDiscontinuity(Rhino.Geometry.Continuity.C2_continuous, a, b, out temp) ) {
        discont.Add(temp);
        pts.Add(C.PointAt(temp));
        a = temp;
      }
    }
      // Check Cinfinity continuity
    else if(L == 3){
      while( C.GetNextDiscontinuity(Rhino.Geometry.Continuity.Cinfinity_continuous, a, b, out temp) ) {
        discont.Add(temp);
        pts.Add(C.PointAt(temp));
        a = temp;
      }
    }


    discont.Add(C.Domain[1]);
    pts.Add(C.PointAt(C.Domain[1]));

    // Get discontinuity points and t parameters
    P = pts;
    t = discont;
# ---------- end c_disc ----------
panel_39 = Panel(c_disc.P)
panel_40 = Panel(c_disc.t)

# ---- group: Grasshopper Disc
disc = Discontinuity(Curve=geo_4, Level="3")  # -> Points, Parameters

# ----
panel_41 = Panel(disc.Points)
panel_42 = Panel(disc.Parameters)

geo_5 = Geometry(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)
c_crvdom = CSharpScript(C=geo_5, D="0 To 2")  # -> out, Cr, Dm; inputs C: Curve
# ---------- c_crvdom: C# ----------
  
    // Component written by @joonhaeng-code
    // This grasshopper component get a domain of curve.
    
    // First, let's export current input curve's domain.
    Dm = C.Domain.ToString();

    // Let's define curve's new domain with input interval D
    C.Domain = D;

    // Let's place our updated Curve into cr as an output.
    Cr = C;
# ---------- end c_crvdom ----------
panel_43 = Panel(c_crvdom.Cr)
panel_44 = Panel(c_crvdom.Dm)
crvdom = CurveDomain(Curve=c_crvdom.Cr)  # -> Curve, Domain
panel_45 = Panel(crvdom.Domain)

# ---- group: Grasshopper CrvDom
crvdom_2 = CurveDomain(Curve=geo_5, Domain="0 To 2")  # -> Curve, Domain

# ----
panel_46 = Panel(crvdom_2.Curve)
panel_47 = Panel(crvdom_2.Domain)
crvdom_3 = CurveDomain(Curve=crvdom_2.Curve)  # -> Curve, Domain
panel_48 = Panel(crvdom_3.Domain)

geo_6 = Geometry(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)
c_lenp = CSharpScript(C=geo_6, P="0.5")  # -> out, L1, L2; inputs C: Curve, P: Double
# ---------- c_lenp: C# ----------
   
    // Component written by @joonhaeng-code
    // This grasshopper component get a split curves' length.
    
    // Get first half length of curve
    L1 = C.Split(P)[0].GetLength();
    
    // Get second half length of curve
    L2 = C.Split(P)[1].GetLength();
# ---------- end c_lenp ----------
panel_49 = Panel(c_lenp.L1)
panel_50 = Panel(c_lenp.L2)

# ---- group: Grasshopper LenP
lenp = LengthParameter(Curve=geo_6, Parameter="0.5")  # -> Length, Length_2

# ----
panel_51 = Panel(lenp.Length)
panel_52 = Panel(lenp.Length_2)

geo_7 = Geometry(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)
c_len = CSharpScript(C=geo_7)  # -> out, L; inputs C: Curve
# ---------- c_len: C# ----------
   
    // Component written by @joonhaeng-code
    // This grasshopper component get a length of curve.
    L = C.GetLength();
# ---------- end c_len ----------
panel_53 = Panel(c_len.L)

# ---- group: Grasshopper Len
len = Length(Curve=geo_7)

# ----
panel_54 = Panel(len)

non_planar_curve = Geometry(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)
curvepoint = PointOnCurve(non_planar_curve, parameter=0.5)
crv_cp_2 = CurveClosestPoint(Point=curvepoint, Curve=non_planar_curve)  # -> Point, Parameter, Distance

# ---- group: C# Curvature
c_cruvature = CSharpScript(C=non_planar_curve, t=crv_cp_2.Parameter)  # -> out, P, K, Cir; inputs C: Curve, t: Double
# ---------- c_cruvature: C# ----------
  
    // Component written by @joonhaeng-code
    // This grasshopper component get a point, curvature and curvature circle on curve parameter t
    
    // get point and curvature at parameter t on curve C
    Point3d pointOnCurve = C.PointAt(t);
    Vector3d curvature = C.CurvatureAt(t);

    // Curvature = 1/r, r = 1/curvature
    double radius = 1.0 / curvature.Length;
    curvature.Unitize();

    // Get center point of curvature circle
    Point3d tempPoint = pointOnCurve + curvature * radius * 2;
    Circle curvatureCircle = new Circle(pointOnCurve, C.TangentAt(t), tempPoint);

    // Outputs
    P = pointOnCurve;
    K = curvature;
    Cir = curvatureCircle;
# ---------- end c_cruvature ----------

# ---- group: Grasshopper Curvature
curvature = Curvature(Curve=non_planar_curve, Parameter=crv_cp_2.Parameter)  # -> P, K, C

# ----
panel_55 = Panel(curvature.P)
panel_56 = Panel(curvature.K)
panel_57 = Panel(curvature.C)
panel_58 = Panel(c_cruvature.P)
panel_59 = Panel(c_cruvature.K)
panel_60 = Panel(c_cruvature.Cir)

non_planar_curve_2 = Geometry(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)
curvepoint_2 = PointOnCurve(non_planar_curve_2, parameter=0.5)
crv_cp_3 = CurveClosestPoint(Point=curvepoint_2, Curve=non_planar_curve_2)  # -> Point, Parameter, Distance
c_cdiv = CSharpScript(C=non_planar_curve_2, t=crv_cp_3.Parameter)  # -> out, P, V; inputs C: Curve, t: Double
# ---------- c_cdiv: C# ----------
  
    // Component written by @joonhaeng-code
    // This grasshopper component get a point and tangent vector on curve parameter t
    
    P = C.PointAt(t);
    V = C.TangentAt(t);
# ---------- end c_cdiv ----------
panel_61 = Panel(c_cdiv.P)
panel_62 = Panel(c_cdiv.V)

# ---- group: Grasshopper CDiv
cdiv = Derivatives(Curve=non_planar_curve_2, Parameter=crv_cp_3.Parameter)  # -> Point, FirstDerivative

# ----
panel_63 = Panel(cdiv.Point)
panel_64 = Panel(cdiv.FirstDerivative)

non_planar_curve_3 = Geometry(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)
curvepoint_3 = PointOnCurve(non_planar_curve_3, parameter=0.5)
crv_cp_4 = CurveClosestPoint(Point=curvepoint_3, Curve=non_planar_curve_3)  # -> Point, Parameter, Distance
c_hframe = CSharpScript(C=non_planar_curve_3, t=crv_cp_4.Parameter)  # -> out, F; inputs C: Curve, t: Double
# ---------- c_hframe: C# ----------
    // Component written by @joonhaeng-code
    // This grasshopper component get a hrozontal plane on curve parameter t.

    // horontal plane' Z Axis will be (0,0,1)
    // Let's remove Z Axis from C tangent vector

    Vector3d temp = new Vector3d(C.TangentAt(t).X, C.TangentAt(t).Y, 0);

    // Since we forced to remove ZAxis value, the size of vector will not be a 1. Make it unit vector
    temp.Unitize();

    // Set PlnX as temp
    Vector3d PlnX = temp;

    // Rotate 90 degreee or 0.25 T and make it as plnY
    temp.Rotate(Math.PI * 0.5, Vector3d.ZAxis);
    Vector3d PlnY = temp;

    // Construct Plane
    Plane horizontalPlane = new Plane(C.PointAt(t), PlnX, PlnY);

    F = horizontalPlane;
# ---------- end c_hframe ----------
panel_65 = Panel(c_hframe.F)

# ---- group: Grasshopper HFrame
hframe = HorizontalFrame(Curve=non_planar_curve_3, Parameter=crv_cp_4.Parameter)

# ----
panel_66 = Panel(hframe)

non_planar_curve_4 = Geometry(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)
c_curvepoint = CSharpScript(C=non_planar_curve_4, l="0.500")  # -> out, P; inputs C: Curve, l: Double
# ---------- c_curvepoint: C# ----------
    // Component written by @joonhaeng-code
    // This grasshopper component get a point and middle( length) of the curve
    
    P = C.PointAtLength(C.GetLength() * l);
# ---------- end c_curvepoint ----------
panel_67 = Panel(c_curvepoint.P)

# ---- group: Grasshopper CurvePoint
curvepoint_4 = PointOnCurve(non_planar_curve_4, parameter=0.5)

# ----
panel_68 = Panel(curvepoint_4)

crv_5 = Geometry(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)

# ---- group: Grasshopper DArc
darc = DeconstructArc(Arc=crv_5)  # -> BasePlane, Radius, Angle

# ---- group: C# DArc
c_script = CSharpScript(A=crv_5)  # -> out, B, R, An
# ---------- c_script: C# ----------
    // Component written by @joonhaeng-code
    // joonhaenglee@gsd.harvard.edu

    // We will get Plane, Radius and Angle Domain of input arc.
    // Those are the properties of the arc.
    // We can get those value by using function below.

    B = A.Plane;
    R = A.Radius;
    An = A.AngleDomain;
# ---------- end c_script ----------

# ----
panel_69 = Panel(darc.BasePlane)
panel_70 = Panel(darc.Radius)
panel_71 = Panel(darc.Angle)
panel_72 = Panel(c_script.B)
panel_73 = Panel(c_script.R)
panel_74 = Panel(c_script.An)

crv_6 = Curve(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)
c_cpoly = CSharpScript(C=crv_6)  # -> out, CP, P; inputs C: Curve
# ---------- c_cpoly: C# ----------
    // Component written by @joonhaeng-code
    // joonhaenglee@gsd.harvard.edu

    // We will get Control Points of input curve and polyline that links those points.
    // So, first, let's make a empty list to contain the control points.

    List<Point3d> Points = new List<Point3d>();

    for (int i = 0, n = C.ToNurbsCurve().Points.Count; i < n; i++)
    {
      // It does not mean that Control Point is same as point.
      // To get XYZ coordinate of control point, we have do extract XYZ value from control points and make a new points.
      // Meanwhile, to get Control Points from Curve, we have to convert Curve to Nurbscurve.
      // To do that, we can use
      // Curve.ToNurbsCurve()

      // So, X coordiate of ith Control Point of Curve may looks like following.
      // C.ToNurbsCurve().Points[i].X

      Point3d temp = new Point3d(C.ToNurbsCurve().Points[i].X, C.ToNurbsCurve().Points[i].Y, C.ToNurbsCurve().Points[i].Z);

      //Let's add this temp to our point list.
      Points.Add(temp);
    }

    // We can simply make polyline using Point list by using below.
    Polyline pl = new Polyline(Points);

    // Finally, let's make pl and Points as output of this C# components.
    CP = pl;
    P = Points;
# ---------- end c_cpoly ----------
panel_75 = Panel(c_cpoly.CP)
panel_76 = Panel(c_cpoly.P)

# ---- group: Grasshopper CPoly
cpoly = ControlPolygon(Curve=crv_6)  # -> Polygon, Points

# ----
panel_77 = Panel(cpoly.Polygon)
panel_78 = Panel(cpoly.Points)

crv_7 = Curve(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)

# ---- group: Grasshopper End
end = EndPoints(Curve=crv_7)  # -> Start, End

# ---- group: C# End Points
c_end = CSharpScript(C=crv_7)  # -> out, S, E; inputs C: Curve
# ---------- c_end: C# ----------
    // Component written by @joonhaeng-code
    // joonhaenglee@gsd.harvard.edu

    // Now we will get start Point and end point of input curve.
    // From Properties tap in Curve Class we can find that those two values are inherent properties of the curve.
    // So we can get those value easily by using function below.

    S = C.PointAtStart;
    E = C.PointAtEnd;
# ---------- end c_end ----------

# ----
panel_79 = Panel(end.End)
panel_80 = Panel(end.Start)
panel_81 = Panel(c_end.S)
panel_82 = Panel(c_end.E)

non_planar_curve_5 = Geometry(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)
c_frame = CSharpScript(C=non_planar_curve_5, t="50")  # -> out, F; inputs C: Curve, t: Double
# ---------- c_frame: C# ----------
    // Component written by @joonhaeng-code
    // This grasshopper component get a frame plane of the curve

    Plane tempPl = new Plane(C.PointAt(t), C.TangentAt(t), C.CurvatureAt(t));
    F = tempPl;
# ---------- end c_frame ----------
panel_83 = Panel(c_frame.F)

# ---- group: Grasshopper Frame
frame = CurveFrame(Curve=non_planar_curve_5, Parameter="50")

# ----
panel_84 = Panel(frame)
