# Grasshopper definition Curve_Primitive.ghx (Grasshopper 1.0.7)

number_slider = Slider(10, range=0..10)
pt = Point(Point(30.8022043, -44.10034382, 0))
vec = Vector(Vector(175.5572344, 356.437075, 0))
c_line = CSharpScript(S=pt, D=vec, L=number_slider)  # -> out, Line; inputs S: Point3d, D: Vector3d, L: Double
# ---------- c_line: C# ----------
//Component written by @Suekim37
//Create a line with starting point, direction vector, and line length
Line line = new Line(S, D, L);


//output
Line = line;
# ---------- end c_line ----------
panel = Panel(c_line.Line)
line = Line(c_line.Line)

# ---- group: Grasshopper Line
line_2 = LineSDL(Start=pt, Direction=vec, Length=number_slider)

# ----
line_3 = Line(line_2)
panel_2 = Panel(line_2)

number_slider_2 = Slider(8.6, range=0..10)
pln = Plane(Plane(origin=(40.29354661, 70.88856589, 0), x=(-0.38110474, 0.9245318692, 0), y=(-0.9245318692, -0.38110474, 0)))
c_cir = CSharpScript(P=pln, R=number_slider_2)  # -> out, C; inputs P: Plane, R: Double
# ---------- c_cir: C# ----------
//Component written by @Suekim37
//Create a circle with plane and radius
Circle circle = new Circle(P, R);

//output
C = circle;
# ---------- end c_cir ----------
panel_3 = Panel(c_cir.C)
circle = Circle(c_cir.C)

# ---- group: Grasshopper Cir
cir = Circle(Plane=pln, Radius=number_slider_2)

# ----
panel_4 = Panel(cir)
circle_2 = Circle(cir)

number_slider_3 = Slider(8.6, range=0..10)
pt_2 = Point(Point(-8.844056887, 75.87621468, 0))
vec_2 = Vector(Vector(93.19585365, 32.9231477, 0))
c_circle = CSharpScript(C=pt_2, N=vec_2, R=number_slider_3)  # -> out, Cir; inputs C: Point3d, N: Vector3d, R: Double
# ---------- c_circle: C# ----------
//Component written by @Suekim37
//Create a plane with the center point and a normal vector
Plane plane = new Plane(C, N);

//Create a circle with the plane and radius
Circle circle = new Circle(plane, R);

//output
Cir = circle;
# ---------- end c_circle ----------
circle_3 = Circle(c_circle.Cir)
panel_5 = Panel(c_circle.Cir)

# ---- group: Grasshopper Circle
circle_4 = CircleCNR(Center=pt_2, Normal=vec_2, Radius=number_slider_3)

# ----
circle_5 = Circle(circle_4)
panel_6 = Panel(circle_4)

number_slider_4 = Slider(3.5, range=0..10)
number_slider_5 = Slider(5, range=0..10)
pln_2 = Plane(Plane(origin=(2.442382, -22.92411509, 0), x=(-0.0943512179, 0.9955389735, 0), y=(0.9955389735, 0.0943512179, 0)))
c_ellipse = CSharpScript(P=pln_2, R1=number_slider_4, R2=number_slider_5)  # -> out, E, F1, F2; inputs P: Plane, R1: Double, R2: Double
# ---------- c_ellipse: C# ----------
//Component written by @Suekim37
//R1 is an ellipse radius along base plane X direction.
//R2 is an ellipse radius along base plane Y direction. @Rhinocommon

//Focus of Ellipse
//An ellipse is defined by two points, each called a focus. (F1, F2 here).
//If you take any point on the ellipse, the sum of the distances to the focus points is constant.
//source: https://www.mathopenref.com/ellipse.html

//Create an epllipse
Ellipse e = new Ellipse(P, R1, R2);

//Get the distance between the foci and the center
double F = Math.Sqrt(Math.Abs((R1 * R1) - (R2 * R2)));

//Get the foci point from the center point of ellipse
Point3d foci1 = new Point3d(P.Origin + P.YAxis * F);
Point3d foci2 = new Point3d(P.Origin - P.YAxis * F);

//output
E = e; // geometry
F1 = foci1; 
F2 = foci2;
# ---------- end c_ellipse ----------
panel_7 = Panel(c_ellipse.F2)
pt_3 = Point(c_ellipse.F1)
pt_4 = Point(c_ellipse.F2)
geo = Geometry(c_ellipse.E)
panel_8 = Panel(c_ellipse.F1)

# ---- group: Grasshopper Ellipse
ellipse = Ellipse(Plane=pln_2, Radius1=number_slider_4, Radius2=number_slider_5)  # -> Ellipse, Focus1, Focus2

# ----
geo_2 = Geometry(ellipse.Ellipse)
panel_9 = Panel(ellipse.Focus2)
pt_5 = Point(ellipse.Focus1)
pt_6 = Point(ellipse.Focus2)
panel_10 = Panel(ellipse.Focus1)

number_slider_6 = Slider(9.7, range=0..10)
number_slider_7 = Slider(3, range=0..10)
pln_3 = Plane(Plane(origin=(-205.3293543, -264.8921459, 0), x=(0.8033042613, 0.5955688574, 0), y=(0.1239811881, -0.1672260319, -0.9780920812)))
c_arc = CSharpScript(P=pln_3, R=number_slider_6, A=number_slider_7)  # -> out, Arc, L; inputs P: Plane, R: Double, A: Double
# ---------- c_arc: C# ----------
//Component written by @Suekim37
//Create an arc from plane, radius and angle
Arc arc = new Arc(P, R, A);

Arc = arc;
L = arc.Length;
# ---------- end c_arc ----------
arc = CircularArc(c_arc.Arc)
panel_11 = Panel(c_arc.L)

# ---- group: Grasshopper Arc
arc_2 = Arc(Plane=pln_3, Radius=number_slider_6, Angle=number_slider_7)  # -> Arc, Length

# ----
arc_3 = CircularArc(arc_2.Arc)
panel_12 = Panel(arc_2.Length)

# ----
# Curve Primitive
pt_7 = Point([Point(155.8388528, 71.52896409, 0), Point(51.30531797, 108.1264096, 0), Point(73.84949321, 151.7913449, 0), Point(-21.15314735, 182.7391885, 0), Point(13.84048851, 76.2304555, 0), Point(93.00540162, 50.08050932, 0), Point(183.6595771, 31.76672344, 0), Point(135.6409858, 173.1669196, 0), Point(69.04437681, 82.55870659, 0), Point(187.854755, 76.16309522, 0), Point(-13.72068491, 121.8715823, 0)])
c_fline = CSharpScript(P=pt_7)  # -> out, L; inputs P: list of Point3d
# ---------- c_fline: C# ----------
//Component written by @Suekim37
//Define a new line
Line line = new Line();

//Fit the line to the input points
//Output of this command is stored in line
Line.TryFitLineToPoints(P, out line);

//output
L = line;
# ---------- end c_fline ----------
line_4 = Line(c_fline.L)
panel_13 = Panel(c_fline.L)

# ---- group: Grasshopper FLine
fline = FitLine(Points=pt_7)

# ----
line_5 = Line(fline)
panel_14 = Panel(fline)

circle_6 = Circle({Plane=Plane(origin=(7.715534002, 219.9828951, 0), x=(0.2519473513, -0.9677409427, 0), y=(0.9677409427, 0.2519473513, 0)), Radius=77.38693699})
circle_7 = Circle({Plane=Plane(origin=(10.4370723, 9.75584062, 0), x=(0.7579917419, -0.6522641483, 0), y=(0.6522641483, 0.7579917419, 0)), Radius=18.19682297})
c_tanex = CSharpScript(A=circle_6, B=circle_7)  # -> out, T1, T2
# ---------- c_tanex: C# ----------
    //Component written by @joon @Suekim37
    //Get the center and the radius of each circle
    Point3d pt1 = A.Center;
    Point3d pt2 = B.Center;
    double r1 = A.Radius;
    double r2 = B.Radius;

    //We can calculate the angle by using acos.
    //First, get the distance between the centers.
    double dist_center = pt1.DistanceTo(pt2);

    //Get the difference of two radius
    double dist_rad = Math.Abs(r1 - r2);

    //Get the angle of bigger circle
    double angle = Math.Acos(dist_rad / dist_center);

    //Create a vector from a smaller circle center to a bigger circle center
    Vector3d v1 ;
    if (r1 < r2){
      v1 = pt1 - pt2;
    }
    else {
      v1 = pt2 - pt1;
    }
    //Unitize and rotate the vector with the angle we got above.
    //It will be a unit vector towards the tangent point
    v1.Unitize();
    v1.Rotate(angle, A.Plane.ZAxis);


    //Get the tangent points
    //Start the vector from each center and multiply it by each circle radius
    Point3d r1_tan = pt1 + (v1 * r1);
    Point3d r2_tan = pt2 + (v1 * r2);

    //Get another tangent points
    //Rotate the vector to the other side to get another tangent point
    v1.Rotate(-2.0 * angle, A.Plane.ZAxis);
    Point3d r1_tan2 = pt1 + (v1 * r1);
    Point3d r2_tan2 = pt2 + (v1 * r2);

    //Connect the points!
    Line L1 = new Line(r1_tan, r2_tan);
    Line L2 = new Line(r1_tan2, r2_tan2);

    //outputs
    T1 = L1;
    T2 = L2;
# ---------- end c_tanex ----------
line_6 = Line(c_tanex.T1)
line_7 = Line(c_tanex.T2)

# ---- group: Grasshopper TanEx
tanex = TangentLinesEx(CircleA=circle_6, CircleB=circle_7)  # -> Tangent1, Tangent2

# ----
line_8 = Line(tanex.Tangent1)
line_9 = Line(tanex.Tangent2)

pt_8 = Point(Point(-261.7124038, -250.896599, 0))
pt_9 = Point(Point(-264.9899016, -285.6511768, 0))
vec_3 = Vector(Vector(-209.7498489, -298.3924404, 0))
c_arc_2 = CSharpScript(S=pt_8, E=pt_9, D=vec_3)  # -> out, Arc, P, R; inputs S: Point3d, E: Point3d, D: Vector3d
# ---------- c_arc_2: C# ----------
//Component written by @Suekim37
//Create an arc from start point, end point, and the direction
Arc arc = new Arc(S, D, E);

Arc = arc;
P = arc.Plane;
R = arc.Radius;
# ---------- end c_arc_2 ----------
arc_4 = CircularArc(c_arc_2.Arc)
pln_4 = Plane(c_arc_2.P)
panel_15 = Panel(c_arc_2.R)

# ---- group: Grasshopper Arc
arc_5 = ArcSED(Start=pt_8, End=pt_9, Direction=vec_3)  # -> Arc, Plane, Radius

# ----
pln_5 = Plane(arc_5.Plane)
panel_16 = Panel(arc_5.Radius)
arc_6 = CircularArc(arc_5.Arc)

pt_10 = Point(Point(51.64304902, 11.48408087, 0))
pt_11 = Point(Point(90.04353155, 431.0087378, 0))
c_ln = CSharpScript(A=pt_10, B=pt_11)  # -> out, L; inputs A: Point3d, B: Point3d
# ---------- c_ln: C# ----------
//Component written by @Suekim37
//Create a line with two points 
Line line = new Line(A,B);

//output
L = line;
# ---------- end c_ln ----------
line_10 = Line(c_ln.L)
panel_17 = Panel(c_ln.L)

# ---- group: Grasshopper Ln
ln = Line(StartPoint=pt_10, EndPoint=pt_11)

# ----
line_11 = Line(ln)
panel_18 = Panel(ln)

line_12 = Line(Line((36.37579819, 31.61502154, 0), (66.44652427, 29.5490938, 0)))
pt_12 = Point(Point(93.00540162, 50.08050932, 0))
pt_13 = Point(Point(-67.62681419, 108.9522877, 0))
c_ln4pt = CSharpScript(L=line_12, A=pt_12, B=pt_13)  # -> out, Line; inputs L: Line, A: Point3d, B: Point3d
# ---------- c_ln4pt: C# ----------
//Component written by @Suekim37
//Define two points
Point3d a = new Point3d();
Point3d b = new Point3d();

//Get the points projected on the line
a = L.ClosestPoint(A, false); 
b = L.ClosestPoint(B, false);

//Make a line with projected points
Line line = new Line(a,b);

//output
Line = line;
# ---------- end c_ln4pt ----------
line_13 = Line(c_ln4pt.Line)
panel_19 = Panel(c_ln4pt.Line)

# ---- group: Grasshopper Ln4Pt
ln4pt = Line4Pt(Line=line_12, PointA=pt_12, PointB=pt_13)

# ----
line_14 = Line(ln4pt)
panel_20 = Panel(ln4pt)

pt_14 = Point(Point(31.60245599, -1.72550109, 0))
circle_8 = Circle({Plane=Plane(origin=(17.84871099, -18.26387632, 0), x=(-0.6049502706, 0.7962632543, 0), y=(-0.7962632543, -0.6049502706, 0)), Radius=10.9756345})
c_tan = CSharpScript(P=pt_14, C=circle_8)  # -> out, T1, T2; inputs P: Point3d
# ---------- c_tan: C# ----------
Point3d tan = new Point3d();
//0.5* Math.PI = Vector3d.VectorAngle(C.Center - tan, P - tan);
# ---------- end c_tan ----------
line_15 = Line(c_tan.T1)
line_16 = Line(c_tan.T2)
panel_21 = Panel(c_tan.T1)
panel_22 = Panel(c_tan.T2)

# ---- group: Grasshopper Tan
tan = TangentLines(Point=pt_14, Circle=circle_8)  # -> Tangent1, Tangent2

# ----
line_17 = Line(tan.Tangent1)
line_18 = Line(tan.Tangent2)
panel_23 = Panel(tan.Tangent1)
panel_24 = Panel(tan.Tangent2)

circle_9 = Circle({Plane=Plane(origin=(-237.4107737, -115.0053346, 0), x=(-0.1828460778, -0.9831415523, 0), y=(0.9831415523, -0.1828460778, 0)), Radius=24.42570758})
circle_10 = Circle({Plane=PlaneXY(-219.5202983, -213.3510707, 0), Radius=49.19498341})
c_tanin = CSharpScript(A=circle_9, B=circle_10)  # -> out, T1, T2
# ---------- c_tanin: C# ----------
    //Component written by @joon @Suekim37
    //Get the center and the radius of each circle
    Point3d pt1 = A.Center;
    Point3d pt2 = B.Center;
    double r1 = A.Radius;
    double r2 = B.Radius;

    //We can calculate the angle by using acos.
    //First, get the distance between the centers.
    double dist_center = pt1.DistanceTo(pt2);

    //Get the angle and the vector from the center to the tangent point
    double angle = Math.Acos(r1 / dist_center);

    Vector3d v = A.TangentAt(angle);
    v.Rotate(angle, A.Plane.ZAxis);

    Point3d r1_tan1 = pt1 - (v * r1);
    Point3d r2_tan1 = pt2 + (v * r2);

    //Connect the points!
    Line L1 = new Line(r1_tan1, r2_tan1);


    //Create another tangent line by mirroring it
    Vector3d centers = new Vector3d(pt2 - pt1);
    Plane pl = new Plane(pt1, centers, A.Plane.ZAxis);
    Transform mi = Transform.Mirror(pl);

    //outputs
    T1 = L1;
    L1.Transform(mi);
    T2 = L1;
# ---------- end c_tanin ----------
line_19 = Line(c_tanin.T1)
line_20 = Line(c_tanin.T2)

# ---- group: Grasshopper TanIn
tanin = TangentLinesIn(CircleA=circle_9, CircleB=circle_10)  # -> Tangent1, Tangent2

# ----
line_21 = Line(tanin.Tangent1)
line_22 = Line(tanin.Tangent2)

pt_15 = Point(Point(59.84576683, -56.08766616, 0))
pt_16 = Point(Point(14.28961613, -57.39863453, 0))
pt_17 = Point(Point(110.645791, -17.08635728, 0))
c_circle_2 = CSharpScript(A=pt_15, B=pt_16, C=pt_17)  # -> out, Cir, P, R; inputs A: Point3d, B: Point3d, C: Point3d
# ---------- c_circle_2: C# ----------
//Component written by @Suekim37
//Define a circle with three points
Circle circle = new Circle(A, B, C);


//outputs
Cir = circle;
P = circle.Plane;
R = circle.Radius;
# ---------- end c_circle_2 ----------
circle_11 = Circle(c_circle_2.Cir)
pln_6 = Plane(c_circle_2.P)
panel_25 = Panel(c_circle_2.R)

# ---- group: Grasshopper Circle
circle_12 = Circle3Pt(PointA=pt_15, PointB=pt_16, PointC=pt_17)  # -> Circle, Plane, Radius

# ----
circle_13 = Circle(circle_12.Circle)
pln_7 = Plane(circle_12.Plane)
panel_26 = Panel(circle_12.Radius)

pt_18 = Point([Point(-121.1336366, 92.4062709, 0), Point(-116.1971314, 74.67141895, 0), Point(-127.0284732, 65.55135763, 0), Point(-92.37420679, 98.42848215, 0), Point(-94.69990153, 59.96386069, 0), Point(-107.6039557, 66.7654269, 0)])
c_fcircle = CSharpScript(P=pt_18)  # -> out, C, R, D; inputs P: list of Point3d
# ---------- c_fcircle: C# ----------
    //Component written by @Suekim37
    //This C# code is to create a circle fitting to the given points.
    //Rhinocommon has the same function as Grasshopper component, but it is returning a different result sometimes.
   

    //Fit a circle to the given points list
    //The output is stored in 'out c'
    Circle c = new Circle();
    Circle.TryFitCircleToPoints(P, out c);

    //Get the maximum distance between circle and points.
    //For that, create a distance list at first.
    List<double> dists = new List<double>();

    //Get the closest points on the circle from each point on the list.
    //Get the distance of each of pair, and store them to the list created above.
    for (int i = 0; i < P.Count; i++)
    {
      Point3d p = c.ClosestPoint(P[i]);
      double dist = p.DistanceTo(P[i]);
      dists.Add(dist);
    }

    //sort the list by distance value (ascending) to get the maximum value
    dists.Sort();

    //Outputs
    C = c;
    R = c.Radius;
    D = dists[P.Count - 1]; // the last value of the distance list
# ---------- end c_fcircle ----------
circle_14 = Circle(c_fcircle.C)
panel_27 = Panel(c_fcircle.R)
panel_28 = Panel(c_fcircle.D)

# ---- group: Grasshopper FCircle
fcircle = CircleFit(Points=pt_18)  # -> Circle, Radius, Deviation

# ----
circle_15 = Circle(fcircle.Circle)
panel_29 = Panel(fcircle.Radius)
panel_30 = Panel(fcircle.Deviation)

crv = Curve(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)
crv_2 = Curve(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)
crv_3 = Curve(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)
pt_19 = Point(Point(-3.080714717, 58.29432374, 0))

# ---- group: C# CircleTTT
c_circlett = CSharpScript(A=crv, B=crv_2, C=crv_3, P=pt_19)  # -> out, Cir; inputs A: Curve, B: Curve, C: Curve, P: Point3d
# ---------- c_circlett: C# ----------
//Component written by @Suekim37
//x and y are the parameters on first and second curve close to desired solution respectively
double x = 0.1;
double y = 0.1;
double z = 0.1;

//Try to fit a circle to two curves using tangent relationships @Rhinocommon
//output
Cir = Circle.TryFitCircleTTT(A, B, C, x, y, z);
# ---------- end c_circlett ----------

# ---- group: Grasshopper CircleTTT
circlettt = CircleTanTanTan(CurveA=crv, CurveB=crv_2, CurveC=crv_3, Point=pt_19)

# ----
circle_16 = Circle(circlettt)
panel_31 = Panel(circlettt)
circle_17 = Circle(c_circlett.Cir)
panel_32 = Panel(c_circlett.Cir)

pt_20 = Point(Point(-11.07504258, 0.9097356401, 0))
pt_21 = Point(Point(-7.437512648, -10.93983342, 0))
pt_22 = Point(Point(-3.40162022, 0.1186611705, 0))
c_incircle = CSharpScript(A=pt_20, B=pt_21, C=pt_22)  # -> out, Cir, P, R; inputs A: Point3d, B: Point3d, C: Point3d
# ---------- c_incircle: C# ----------
//Component written by @Suekim37

//Draw temporary lines from the points
Line a = new Line(A,B);
Line b = new Line(B,C);
Line c = new Line(C,A);

//Convert lines to curves to fit a circle in it
Curve c1 = a.ToNurbsCurve();
Curve c2 = b.ToNurbsCurve();
Curve c3 = c.ToNurbsCurve();

//Fit a circle in the triangle
Circle circle = Circle.TryFitCircleTTT(c1,c2,c3, 0.1, 0.1, 0.1);
//Create plane from the normal vector and the center point of circle.
Plane pl = new Plane(circle.Center, circle.Normal);

//Outputs
Cir = circle;
P = pl;
R = circle.Radius;
# ---------- end c_incircle ----------
circle_18 = Circle(c_incircle.Cir)
pln_8 = Plane(c_incircle.P)
panel_33 = Panel(c_incircle.R)

# ---- group: Grasshopper InCircle
incircle = InCircle(CornerA=pt_20, CornerB=pt_21, CornerC=pt_22)  # -> Circle, Plane, Radius

# ----
circle_19 = Circle(incircle.Circle)
pln_9 = Plane(incircle.Plane)
panel_34 = Panel(incircle.Radius)

pt_23 = Point(Point(-261.7124038, -250.896599, 0))
pt_24 = Point(Point(-264.9899016, -285.6511768, 0))
pt_25 = Point(Point(-261.1869512, -313.4963266, 0))
c_arc_3 = CSharpScript(A=pt_23, B=pt_24, C=pt_25)  # -> out, Arc, P, R; inputs A: Point3d, B: Point3d, C: Point3d
# ---------- c_arc_3: C# ----------
    //Component written by @Suekim37
    //Create an arc from three points
    Arc arc = new Arc(A, B, C);

    //outputs
    Arc = arc;
    P = arc.Plane;
    R = arc.Radius;
# ---------- end c_arc_3 ----------
arc_7 = CircularArc(c_arc_3.Arc)
pln_10 = Plane(c_arc_3.P)
panel_35 = Panel(c_arc_3.R)

# ---- group: Grasshopper Arc
arc_8 = Arc3Pt(PointA=pt_23, PointB=pt_24, PointC=pt_25)  # -> Arc, Plane, Radius

# ----
arc_9 = CircularArc(arc_8.Arc)
pln_11 = Plane(arc_8.Plane)
panel_36 = Panel(arc_8.Radius)
