# Grasshopper definition Surface_Freeform.ghx (Grasshopper 1.0.7)

# ----
# GH#: A C# dictionary of Grasshopper3D components.
# 
# This file contains a category of Grasshopper components, and a mirroring C#/RhinoCommon implementation.
# 
# This is an educational project initiated by students/faculty of GSD-6338: Introduction to Computational Design, at the Harvard Graduate School of Design.
# 
# More information: {{project link}}
# Surface Freeform
# Surface Primitive Difficulties: Control Point Loft (CPLoft)
# Fit Loft (FitLoft)
# Loft Options (LoftOpt)
# Extrude Linear (Extrude)
# Extrude Along (ExtrCrv)
# Patch- inputs are not identical to Grasshopper -> result not identical.
# Fragment Patch (FPatch)- have not found something similar in Rhino Common.
# Variable Pipe (VPipe)- not identical to grasshopper component
pt = Point(Point(-5.736158344, -5.736158344, 0))
pt_2 = Point(Point(-5.736158344, 5.736158344, 0))
pt_3 = Point(Point(5.736158344, 5.736158344, 0))
pt_4 = Point(Point(5.736158344, -5.736158344, 0))
srf4pt = _4PointSurface(CornerA=pt, CornerB=pt_2, CornerC=pt_3, CornerD=pt_4)
gh_srf4pt = CSharpScript(A=pt, B=pt_2, C=pt_3, D=pt_4)  # -> out, S; inputs A: Point3d, B: Point3d, C: Point3d, D: Point3d
# ---------- gh_srf4pt: C# ----------
    //Component written by @erinlinseyhunt

    //Create a nurbs surface from four corner points. The fifth input is a tolerance.
    NurbsSurface a = NurbsSurface.CreateFromCorners(A, B, C, D, 0.1);

    //Output
    S = a;
# ---------- end gh_srf4pt ----------
geo = Geometry(srf4pt)
geo_2 = Geometry(gh_srf4pt.S)

crv = Curve(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)
crv_2 = Curve(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)
loft_types = Slider(2, range=0..5)
loft = Loft(Curves=[crv, crv_2], Options={Adjust=False, Closed=False, LoftEnds=0, LoftSimp=0, LoftType=0, Rebuild=10, Refit=0.01})
gh_loft = CSharpScript(C=[crv, crv_2], O=loft_types)  # -> out, L; inputs C: list of Curve, O: Int32
# ---------- gh_loft: C# ----------
    //Component written by @erinlinseyhunt

    //Casting to LoftType
    //Normal (0), Loose (1), Tight (2), Straight (3), Developable (4), Uniform (5)
    LoftType LT = (LoftType) O;

    //Creating a loft from a list of points
    Brep[] loft = Brep.CreateFromLoft(C, Point3d.Unset, Point3d.Unset, 0, false);

    //Output
    L = loft;
# ---------- end gh_loft ----------
geo_3 = Geometry(loft)
geo_4 = Geometry(gh_loft.L)

crv_3 = Curve([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])
crv_4 = Curve([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])
number_slider = Slider(2, range=0..100)
gh_netsurf = CSharpScript(U=crv_3, V=crv_4, C=number_slider)  # -> out, S; inputs U: list of Curve, V: list of Curve, C: Int32
# ---------- gh_netsurf: C# ----------
    //Component written by @erinlinseyhunt

    //declaring
    int e;

    //Builds a surface from an ordered network of curves.
    NurbsSurface a = NurbsSurface.CreateNetworkSurface(U, C, C, V, C, C, 1.0, 1.0, 1.0, out e);

    //Output
    S = a;
# ---------- end gh_netsurf ----------
netsurf = NetworkSurface(CurvesU=crv_3, CurvesV=crv_4, Continuity=number_slider)
geo_5 = Geometry(netsurf)
geo_6 = Geometry(gh_netsurf.S)

crv_5 = Curve(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)
crv_6 = Curve(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)
sumsrf = SumSurface(CurveA=crv_5, CurveB=crv_6)
gh_sumsrf = CSharpScript(A=crv_5, B=crv_6)  # -> out, S; inputs A: Curve, B: Curve
# ---------- gh_sumsrf: C# ----------
    //Component written by @erinlinseyhunt

    //Creates a surface from two perpendicular curves.
    Surface C = SumSurface.Create(A, B);

    //Output
    S = C;
# ---------- end gh_sumsrf ----------
geo_7 = Geometry(sumsrf)
geo_8 = Geometry(gh_sumsrf.S)

crv_7 = Curve(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)
distance = Slider(31, range=0..60)
Z = UnitZ(Factor=distance)
extr = Extrude(Base=crv_7, Direction=Z)
gh_extr = CSharpScript(B=crv_7, D=Z)  # -> out, E; inputs B: Curve, D: Vector3d
# ---------- gh_extr: C# ----------
    //Component written by @erinlinseyhunt

    //Create an extrusion from an input curve and a vector.
    Surface a = Surface.CreateExtrusion(B, D);

    //Output
    E = a;
# ---------- end gh_extr ----------
geo_9 = Geometry(extr)
geo_10 = Geometry(gh_extr.E)

geo_11 = Geometry()
xy = XYPlane(Origin=Point(0, 0, 0))
line = Line()
pln = Plane()
extrude = ExtrudeLinear(Profile=geo_11, OrientationP=xy, Axis=line, OrientationA=pln)
gh_extrude = CSharpScript(Po=xy, A=line, Ao=pln)  # -> Out, E
geo_12 = Geometry(extrude)
geo_13 = Geometry(gh_extrude.E)

crv_8 = Curve([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])
number_slider_2 = Slider(40, range=0..50)
number_slider_3 = Slider(1.5, range=0..3)
patch = Patch(Curves=crv_8, Spans=number_slider_2, Flexibility=number_slider_3, Trim=True)
gh_patch = CSharpScript(C=crv_8, S=number_slider_2, F=number_slider_3)  # -> out, P; inputs C: list of Curve, S: Int32, F: Double
# ---------- gh_patch: C# ----------
    //Component written by @erinlinseyhunt

    //Creates a patch from a list of curves, spans, and a flexibility low the number the less flexible.
    Brep a = Brep.CreatePatch(C, S, S, F);

    //Output
    P = a;
# ---------- end gh_patch ----------
geo_14 = Geometry(patch)
geo_15 = Geometry(gh_patch.P)

crv_9 = Curve(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)
number_slider_4 = Slider(1, range=0..10)
number_slider_5 = Slider(1, range=0..2)
pipe = Pipe(Curve=crv_9, Radius=number_slider_4, Caps=number_slider_5)
gh_pipe = CSharpScript(C=crv_9, R=number_slider_4, E=number_slider_5)  # -> out, P; inputs C: Curve, R: Double, E: Int32
# ---------- gh_pipe: C# ----------
    //Component written by @erinlinseyhunt

    //Casting to PipeCapMode
    PipeCapMode pcm = (PipeCapMode) E;

    //Creating a Pipe
    P = Brep.CreatePipe(C, R, true, pcm, true, 0.1, 0.1);
# ---------- end gh_pipe ----------
geo_16 = Geometry(pipe)
geo_17 = Geometry(gh_pipe.P)

crv_10 = Curve(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)
crv_11 = Curve(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)
toggle = BooleanToggle(False)
swp1 = Sweep1(Rail=crv_10, Sections=crv_11, Miter=toggle)
gh_swp1 = CSharpScript(R1=crv_10, Section=crv_11, H=toggle)  # -> out, S; inputs R1: Curve, Section: Curve, H: Boolean
# ---------- gh_swp1: C# ----------
    //Component written by @erinlinseyhunt

    //Creating a surface from a guide rail and a section curve.
    //If H is true, it creates a sweep with the same-height properties.
    Brep[] a = Brep.CreateFromSweep(R1, Section, H, 0.1);

    //Output
    S = a;
# ---------- end gh_swp1 ----------
geo_18 = Geometry(swp1)
geo_19 = Geometry(gh_swp1.S)

crv_12 = Curve(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)
crv_13 = Curve(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)
line_2 = Line(Line((-0.9052572758, 2.262307137, 0), (-0.9052572758, 2.262307137, 3.845153002)))
toggle_2 = BooleanToggle(True)
railrev = RailRevolution(Curve=crv_12, Rail=crv_13, Axis=line_2, Scale=toggle_2)
gh_railrev = CSharpScript(P=crv_12, R=crv_13, A=line_2, S=toggle_2)  # -> out, surface; inputs P: Curve, R: Curve, A: Line, S: Boolean
# ---------- gh_railrev: C# ----------
    //Component written by @erinlinseyhunt
    
    //Create a surface of revolution using a sweep rail.
    //Inputs defined: P- Profile Curve, R- Rail Curve, A- Rovolution Axis, S- Scale Height of Profile Curve
    NurbsSurface a = NurbsSurface.CreateRailRevolvedSurface(P, R, A, S);
    
    //Output
    surface = a;
# ---------- end gh_railrev ----------
geo_20 = Geometry(railrev)
geo_21 = Geometry(gh_railrev.surface)

crv_14 = Curve(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)
gh_boundary = CSharpScript(E=crv_14)  # -> out, S; inputs E: list of Curve
# ---------- gh_boundary: C# ----------
    //Component written by @erinlinseyhunt

    //Create a planar brep from a list of curves. The second input is the tolerance.
    Brep[] c = Brep.CreatePlanarBreps(E, 0.01);

    //Output
    S = c;
# ---------- end gh_boundary ----------
boundary = BoundarySurfaces(Edges=crv_14)
geo_22 = Geometry(gh_boundary.S)
geo_23 = Geometry(boundary)

crv_15 = Curve(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)
crv_16 = Curve(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)
crv_17 = Curve(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)
crv_18 = Curve(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)
edgesrf = EdgeSurface(CurveA=crv_15, CurveB=crv_16, CurveC=crv_17, CurveD=crv_18)
gh_edgesrf = CSharpScript(A=crv_15, B=crv_16, C=crv_17, D=crv_18)  # -> out, S; inputs A: Curve, B: Curve, C: Curve, D: Curve
# ---------- gh_edgesrf: C# ----------
    //Component written by @erinlinseyhunt

    //Create a new list of curves.
    List<Curve> E = new List<Curve>();


    //Add the four input curves to the new curve list using a for loop.
    for (int i = 0; i < 4; i++)
    {
      E.Add(A);
      E.Add(B);
      E.Add(C);
      E.Add(D);
    }

    //Creates a surface from a list of edge curves
    Brep b = Brep.CreateEdgeSurface(E);

    //Output
    S = b;
# ---------- end gh_edgesrf ----------
geo_24 = Geometry(edgesrf)
geo_25 = Geometry(gh_edgesrf.S)

pt_5 = Point([Point(3.502195346, -2.194951084, 0), Point(-2.704732184, -2.194951084, 0), Point(1.235859161, 2.304070851, 0), Point(-4.433958533, 2.304070851, 0)])
number_slider_6 = Slider(2, range=0..2)
srfgrid = SurfaceFromPoints(Points=pt_5, UCount=number_slider_6, Interpolate=False)
gh_srf_grid = CSharpScript(P=pt_5, U=number_slider_6)  # -> out, S; inputs P: list of Point3d, U: Int32
# ---------- gh_srf_grid: C# ----------
    //Component written by @erinlinseyhunt
    
    //Create a nurbs suface from a grid of points.
    NurbsSurface a = NurbsSurface.CreateFromPoints(P, U, U, U, U);
    
    //Output
    S = a;
# ---------- end gh_srf_grid ----------
geo_26 = Geometry(srfgrid)
geo_27 = Geometry(gh_srf_grid.S)

crv_19 = Curve(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)
crv_20 = Curve(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)
rulesrf = RuledSurface(CurveA=crv_19, CurveB=crv_20)
gh_rulesrf = CSharpScript(A=crv_19, B=crv_20)  # -> out, S; inputs A: Curve, B: Curve
# ---------- gh_rulesrf: C# ----------
    //Component written by @erinlinseyhunt

    //Creates a surface between two curves.
    NurbsSurface a = NurbsSurface.CreateRuledSurface(A, B);
    
    //Output
    S = a;
# ---------- end gh_rulesrf ----------
geo_28 = Geometry(rulesrf)
geo_29 = Geometry(gh_rulesrf.S)

geo_30 = Geometry()
crv_21 = Curve()
extrcrv = ExtrudeAlong(Base=geo_30, Curve=crv_21)
gh_extrcrv = CSharpScript(B=geo_30, C=crv_21)  # -> Out, E
geo_31 = Geometry(extrcrv)
geo_32 = Geometry(gh_extrcrv.E)

crv_22 = Curve(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)
pt_6 = Point(Point(0, 0, 6))
extr_2 = ExtrudePoint(Base=crv_22, Point=pt_6)
gh_extr_2 = CSharpScript(B=crv_22, P=pt_6)  # -> out, E; inputs B: Curve, P: Point3d
# ---------- gh_extr_2: C# ----------
    //Component written by @erinlinseyhunt

    //Extrudes curves to a point
    Surface a = Surface.CreateExtrusionToPoint(B, P);

    //Output
    E = a;
# ---------- end gh_extr_2 ----------
geo_33 = Geometry(extr_2)
geo_34 = Geometry(gh_extr_2.E)

crv_23 = Curve()
fpatch = FragmentPatch(Boundary=crv_23)
gh_fpatch = CSharpScript(B=crv_23)  # -> Out, P
geo_35 = Geometry(fpatch)
geo_36 = Geometry(gh_fpatch.P)

crv_24 = Curve(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)
genes = GenePool(Decimals=2, Maximum=1, Minimum=0, Value=[0, 0.5, 1])
genes_2 = GenePool(Decimals=2, Maximum=1, Minimum=0, Value=[1, 0.45, 1])
caps = Slider(2, range=0..2)
vpipe = PipeVariable(Curve=crv_24, Parameters=genes, Radii=genes_2, Caps=caps)
gh_vpipe = CSharpScript(C=crv_24, t=genes, R=genes_2, E=caps)  # -> out, P; inputs C: Curve, t: list of Double, R: list of Double, E: Int32
# ---------- gh_vpipe: C# ----------
    //Casting to PipeCapMode
    PipeCapMode pcm = (PipeCapMode) E;


    //List<int> mynewt = new List<int>();
    //for (int i = 0; i < t.Count; i++)
    //{
      //mynewt.Add;
    //}

    //Creating a Pipe
    P = Brep.CreatePipe(C, t, R, true, pcm, true, 0.1, 0.1);
# ---------- end gh_vpipe ----------
geo_37 = Geometry(vpipe)
geo_38 = Geometry(gh_vpipe.P)

crv_25 = Curve(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)
crv_26 = Curve(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)
crv_27 = Curve(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)
toggle_3 = BooleanToggle(False)
swp2 = Sweep2(Rail1=crv_25, Rail2=crv_26, Sections=crv_27, SameHeight=toggle_3)
gh_swp2 = CSharpScript(R1=crv_26, R2=crv_25, Section=crv_27, H=toggle_3)  # -> out, S; inputs R1: Curve, R2: Curve, Section: Curve, H: Boolean
# ---------- gh_swp2: C# ----------
    //Component written by @erinlinseyhunt

    //Creating a surface from two guide rails and a section curve.
    //If H is true, it creates a sweep with the same-height properties.
    Brep[] a = Brep.CreateFromSweep(R1, R2, Section, H, 0.1);
    
    //Output
    S = a;
# ---------- end gh_swp2 ----------
geo_39 = Geometry(swp2)
geo_40 = Geometry(gh_swp2.S)

crv_28 = Curve(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)
line_3 = Line(Line((-0.0149407726, -0.1708126088, 0), (-0.0149407726, -0.1708126088, 11.22436453)))
dom = ConstructDomain(DomainStart="0", DomainEnd="2*Pi")
revsrf = Revolution(Curve=crv_28, Axis=line_3, Domain=dom)
gh_revsrf = CSharpScript(P=crv_28, A=line_3, D1="0", D2="2*Pi")  # -> out, S; inputs P: Curve, A: Line, D1: Double, D2: Double
# ---------- gh_revsrf: C# ----------
    //Component written by @erinlinseyhunt
    
    //Creates a surface of revolution using a profile (curve), a revolution axis (line), and a domain start and end. 
    Surface a = RevSurface.Create(P, A, D1, D2);
    
    //Output
    S = a;
# ---------- end gh_revsrf ----------
geo_41 = Geometry(revsrf)
geo_42 = Geometry(gh_revsrf.S)

cploft = ControlPointLoft(Degree=5)
gh_cploft = CSharpScript()  # -> Out, S

fitloft = FitLoft(CountU=15, DegreeU=5, DegreeV=5)
gh_fitloft = CSharpScript()  # -> Out, S

loft_opt = LoftOptions(Closed=False, Adjust=False, Rebuild=0, Refit=0, Type=0)
gh_loft_opt = CSharpScript()  # -> Out, O
